# Grasshopper definition sea_level_rise_scenario.ghx (Grasshopper 1.0.7)
# Copyright: 2020 Richard Chou
# plug-ins: Urbano, DeCodingSpaces

# ----
# Cropping Geometry
crv_cropping_boundary = Curve(<curve referenced from the Rhino model>)
preview = CustomPreview(Geometry=crv_cropping_boundary, Material=ColourSwatch(SwatchColor=RGB(255, 0, 0)))

# ----
# OSM File
path = FilePath("\\Mac\Home\grass_hopper\Topography\map.osm")
panel = Panel(path)

# ----
# Projection
# Translation Vector
utm = Panel("18T")
vector = Panel("0,0,0")
data = Data(utm)

# ----
# SHP File
path_2 = FilePath("\\Mac\Home\grass_hopper\Topography\Data\elevation_grid_5m.shp")
panel_2 = Panel(path_2)

data_2 = Data(vector)

# ---- group: Import OSM Data
importosm = ImportOSMFeatures(
    OSMPathOrURL=path,
    OSMFeatureType="street",
    Format="xml",
    UTMZone=data,
    TranslationVector=data_2,
    CroppingGeometry=crv_cropping_boundary,
    ImportAltitude=False)  # -> Points, Metadata, UTMZone, TranslationVector
pline = PolyLine(Vertices=importosm.Points, Closed=False)

# Import Building from OSM
importosm_2 = ImportOSMFeatures(
    OSMPathOrURL=path,
    OSMFeatureType="building",
    Format="xml",
    UTMZone=data,
    TranslationVector=data_2,
    CroppingGeometry=crv_cropping_boundary,
    ImportAltitude=False)  # -> Points, Metadata, UTMZone, TranslationVector
pline_2 = PolyLine(Vertices=importosm_2.Points, Closed=False)
meta = Metadata(importosm_2.Metadata)

# ---- group: Import Shapefile
# Build Terrain Mesh from Elevation Points
importshp = ImportShapefileFeatures(ShapefilePath=path_2, Reproject=True, UTMZone=data, TranslationVector=data_2, CroppingGeometry=crv_cropping_boundary)  # -> Points, Metadata, UTMZone, TranslationVector

# ----
lookup = LookupMetadata(MetadataGeometry=importshp.Metadata, SearchKey="z_first")  # -> graft(Value)

# ---- group: Lookup building height data
lookup_2 = LookupMetadata(MetadataGeometry=meta, SearchKey="height")

# ---- group: Create metacurve
metacurve = EmbedMetadataIntoCurve(Curve=pline, Metadata=importosm.Metadata)

# ----
move = Move(Geometry=pline_2, Motion="0,0,0.01")  # -> Geometry, Transform

multiplication = Multiplication(A=lookup, B="0.3048")

# ---- group: Split street curves by intersection
splitstr = SplitStreetCurves(SplitStreetCurves=flatten(metacurve), Metadata=flatten(metacurve), IntersectionTolerance=1e-12)  # -> ProcessedStreetCurves, Metadata

# ----
Z = UnitZ(Factor=multiplication)

# ---- group: create Z vector
Z_2 = UnitZ(Factor=lookup_2)

# ----
move_2 = Move(Geometry=importshp.Points, Motion=Z)  # -> flatten(Geometry), Transform

# ---- group: Rebuild MetaCurve
metacurve_2 = EmbedMetadataIntoCurve(Curve=splitstr.ProcessedStreetCurves, Metadata=splitstr.Metadata)

# ----
del = DelaunayMesh(Points=move_2.Geometry, Plane=PlaneXY(0, 0, 0))

# ---- group: Extrude building by height
extr = Extrude(Base=pline_2, Direction=Z_2)
cap = CapHoles(Brep=extr)

# ---- group: Map values to gradiant color
lower_bound = Panel("300")
upper_bound = Panel("0")
num = Number(lookup_2)
gradient = Gradient(
    LowerLimit=lower_bound,
    UpperLimit=upper_bound,
    Parameter=num,
    stops=[0: RGB(250, 249, 217), 0.25: RGB(194, 225, 184), 0.5: RGB(106, 175, 192), 0.75: RGB(63, 95, 166), 1: RGB(36, 35, 88)])

# ---- group: Convert crv to srf
boundary = BoundarySurfaces(Edges=move.Geometry)

# ----
mesh_terrain = Mesh(del)

lookup_3 = LookupMetadata(MetadataGeometry=metacurve_2, SearchKey="bicycle")
lookup_4 = LookupMetadata(MetadataGeometry=metacurve, SearchKey="bicycle")
panel_3 = Panel(lookup_3)
panel_4 = Panel(lookup_4)

contour = Contour(Shape=mesh_terrain, Point=Point(0, 0, 0), Direction=Vector(0, 0, 1), Distance=Slider(1, range=0..10))

# ---- group: Set custom preview colors
preview_2 = CustomPreview(Geometry=metacurve_2, Material=ColourSwatch(SwatchColor=RGB(5, 5, 5)))

srf = Surface(boundary)
preview_3 = CustomPreview(Geometry=srf, Material=ColourSwatch(SwatchColor=RGB(112, 112, 112)))

# ---- group: Set preview colors by gradiant
brep = Brep(cap)
preview_4 = CustomPreview(Geometry=brep, Material=gradient)

# ---- group: Set custom preview colors
preview_5 = CustomPreview(Geometry=mesh_terrain, Material=ColourSwatch(SwatchColor=RGB(106, 115, 98)))

preview_6 = CustomPreview(Geometry=contour, Material=ColourSwatch(SwatchColor=RGB(163, 163, 163)))

# ----
# Import Streets from OSM
crv_street_segments = Curve(metacurve_2)

# ----
# Move Buildings to Terrain
brep_context_buildings = Brep(cap)
mesh_terrain_2 = Mesh(del)

# ----
# Simulate Sea Level Rise
crv_cropping_boundary_2 = Curve(crv_cropping_boundary)

# ----
# Z-value Slider
# Simulate Surface Runoff
number_slider = Slider(20, range=0..20)

# ---- group: Rebuild Mesh into Surface
# Division Resolution (U,V)
number_slider_2 = Slider(100, range=10..100)

# ---- group: Find the Lowest Point
box = EvaluateBox(Box=brep_context_buildings, UParameter="0.5", VParameter="0.5", WParameter="0")  # -> Plane, Point, Include

# ---- group: Create Surface to represent water
boundary_2 = BoundarySurfaces(Edges=crv_cropping_boundary_2)

# ---- group: Project to Terrain Mesh
Z_3 = UnitZ(Factor=1)
project = ProjectPoint(Point=box.Point, Direction=Z_3, Geometry=mesh_terrain_2)  # -> Point, Index

# ---- group: Extrat Z-value of point
pdecon = Deconstruct(Point=project.Point)  # -> XComponent, YComponent, ZComponent

# ---- group: Move surface by Z-value
Z_4 = UnitZ(Factor=number_slider)
move_3 = Move(Geometry=boundary_2, Motion=Z_4)  # -> Geometry, Transform

# ---- group: Move Building by Z-value
Z_5 = UnitZ(Factor=pdecon.ZComponent)
move_4 = Move(Geometry=brep_context_buildings, Motion=Z_5)  # -> Geometry, Transform

# ---- group: Set custom preview colors
preview_7 = CustomPreview(Geometry=move_4.Geometry, Material=ColourSwatch(SwatchColor=RGB(245, 240, 240)))

preview_8 = CustomPreview(Geometry=move_3.Geometry, Material=ColourSwatch(SwatchColor=RGB(127, 153, 184)))

# ----
# Smoothing Factor
number_slider_3 = Slider(0.43, range=0..1)

# ----
# Rebuild Surface
number_slider_4 = Slider(45, range=0..100)

# ----
# Point on Curve (Param)
number_slider_5 = Slider(1, range=0..1)

# ---- group: Rebuild Mesh into Surface
# Rebuild Terrain Mesh as Surface for Analysis
crv_cropping_boundary_3 = Curve(crv_cropping_boundary)
mesh_terrain_3 = Mesh(del)

# ---- group: Rebuild Mesh into Surface / Create Analysis slightly smaller Analysis Srf (ensure projection doesn't fail)
offset = OffsetCurve(Curve=crv_cropping_boundary_3, Distance="-10", Corners=1)
boundary_3 = BoundarySurfaces(Edges=offset)

# ---- group: Rebuild Mesh into Surface / Subdivide Surface for point grid
sdivide = DivideSurface(Surface=boundary_3, UCount=number_slider_2, VCount=number_slider_2)  # -> Points, Normals, Parameters

# ---- group: Rebuild Mesh into Surface / Project point to Mesh
Z_6 = UnitZ(Factor=1)
project_2 = ProjectPoint(Point=sdivide.Points, Direction=Z_6, Geometry=mesh_terrain_3)  # -> Point, Index

# ---- group: Rebuild Mesh into Surface (continued)
flip = FlipMatrix(Data=project_2.Point)

# ---- group: Rebuild Mesh into Surface / Create Network Surface by U, V, Contours
pline_3 = PolyLine(Vertices=flip, Closed=False)  # -> flatten(Polyline)
pline_4 = PolyLine(Vertices=project_2.Point, Closed=False)  # -> flatten(Polyline)
netsurf = NetworkSurface(CurvesU=pline_3, CurvesV=pline_4, Continuity=2)

intcrv = Interpolate(Vertices=flip, Degree=3, Periodic=False, KnotStyle=1)  # -> flatten(Curve), Length, Domain
intcrv_2 = Interpolate(Vertices=project_2.Point, Degree=3, Periodic=False, KnotStyle=1)  # -> flatten(Curve), Length, Domain
netsurf_2 = NetworkSurface(CurvesU=intcrv.Curve, CurvesV=intcrv_2.Curve, Continuity=2)

# ---- group: Preview Terrain Surface
# Rebuild Terrain Mesh as Surface for Analysis
preview_9 = CustomPreview(Geometry=netsurf, Material=ColourSwatch(SwatchColor=RGB(123, 130, 116)))

# ---- group: Calculate Flow Paths
flowpaths = FlowPaths(Terrain=netsurf, Smooth=number_slider_3, UCount=number_slider_4, VCount=number_slider_4)  # -> FlowPathsShort, FlowPathsLong, Terrain
crv_flow_pahts_long = Curve(flowpaths.FlowPathsLong)

# ---- group: Rebuild Polyline into Splines
crv = Curve(graft(crv_flow_pahts_long))
disc = Discontinuity(Curve=crv_flow_pahts_long, Level=1)  # -> Points, Parameters
lng = ListLength(List=disc.Points)
multiplication_2 = Multiplication(A=lng, B=2)
reb = RebuildCurve(Curve=crv, Degree=3, Count=multiplication_2, Tangents=False)

# ---- group: move by z for visibility
Z_7 = UnitZ(Factor=1)
move_5 = Move(Geometry=reb, Motion=Z_7)  # -> Geometry, Transform

# ----
crv_flow_paths = Curve(move_5.Geometry)
eval = EvaluateCurve(Curve=reparameterize(crv_flow_paths), Parameter=number_slider_5)  # -> Point, Tangent, Angle
swatch = ColourSwatch(SwatchColor=RGB(142, 185, 237))
preview_10 = CustomPreview(Geometry=crv_flow_paths, Material=swatch)
preview_11 = CustomPreview(Geometry=eval.Point, Material=swatch)
